vi "GET_INFORMATION_ANALOG.gvi"   [LabVIEW NXG]
inputs:
  "input 0": bool
outputs:
  "16-bit integer": i16[]
panel indicators:
  "error out": error
types:
  T1 = cluster{"sample rate": i32, "number of channels": i32, "bits per sample": i32}
diagram:
  w1 = T1 {"sample rate"=44100, "number of channels"=1, "bits per sample"=16}
  call "Sound Input Configure.gvi"(device ID=0, sound format=w1, sample mode=1, number of samples per channel=100000) -> (task ID=w2, error out=w3)
  call "Sound Input Start.gvi"(task ID=w2, error in=w3) -> (task ID out=w4, error out=w5)
  Logical And($"input 0", FALSE) -> w6
  while {
    call "Sound Input Read.gvi"(task ID=w4, error in=w5, number of samples per channel=10000, timeout=10) -> (task ID out=w7, data=w8, error out=w9)
    Array Index(array=w8) -> (out0[0]=w10)
    Property Node(instance in=w10) -> ("Y"=w11)
    To Word Integer(number=w11) -> w12
    $"16-bit integer" <- w12
    stop if w6
  }
  call "Sound Input Clear.gvi"(task ID=w7, error in=w9) -> (error out=w13)
  $"error out" <- w13
