vi "PulsModulate.gvi"   [LabVIEW NXG]
inputs:
  "input bit stream": f64[]
outputs:
  "Y": c128[]
panel indicators:
  "bits per symbol": i32
  "error out": error
diagram:
  call "MT Generate PSK System Parameters(map).gvi"(PSK type="normal", samples per symbol=16, symbol values=[0, 1, 3, 2], differential PSK="disable") -> (PSK system parameters=w1, bits per symbol=w2, error out=w3)
  To Byte Integer(number=$"input bit stream") -> w4
  call "MT Generate Filter Coefficients.gvi"(pulse shaping filter="none", pulse shaping samples per symbol=16, matched samples per symbol=16, filter parameter=0.5, modulation type="PSK") -> (pulse shaping filter coefficients=w5, error out=w6)
  # TODO
  # -> find correct PSK system paratmers
  # -> number of samples per symbol ?!
  # -> construction of 16-bit output array
  #
  # -> AS ALWAYS
  # -> -> DATA SYNCHRONIZATION&QUEUING
  call "MT Modulate PSK.gvi"(input bit stream=w4, PSK system parameters=w1, symbol rate=200000, pulse shaping filter coefficients=w5, error in=w3, reset?=TRUE, flush buffers?=FALSE) -> (output complex waveform=w7)
  Property Node(instance in=w7) -> ("Y"=w8)
  $Y <- w8
  $"bits per symbol" <- w2
  $"error out" <- w6
