vi "Tx.gvi"   [LabVIEW NXG]
panel controls:
  "Source - Micro OR Audio-File": i32 = "Microphone"(0)
  "STOPS MICROPHONE RECORDING": bool
  "STOPS READING FROM AUDIO FILE": bool
  "Attached USRP": string
panel indicators:
  "DO NOT REMOVE!!!": i32
  "Error OUTPUT": error
diagram:
  call "PulsModulate.gvi"()
  call "Tx_Format.gvi"()
  call "niUSRP Open Tx Session.gvi"(Device names=$"Attached USRP", Reset=TRUE) -> (Error Out=w1, Session handle=w2)
  call "niUSRP Configure Signal.gvi"(session handle=w2, IQ rate=44100, carrier frequency=2450000000, gain=0, error in (no error)=w1, channel list="0,1", active antenna="RX2") -> (session handle out=w3, Error Out=w4)
  case ($"Source - Micro OR Audio-File") {
    frame 0, Default {
      while {
        call "GET_INFORMATION_ANALOG.gvi"(input 0=$"STOPS MICROPHONE RECORDING") -> (16-bit integer=w7)
        call "niUSRP Write Tx Data (I16).gvi"(session handle=w3, data=w7, timeout=10, end of data?=$"STOPS MICROPHONE RECORDING", error in (no error)=w4, channel list="0,1") -> (session handle out=w5, Error Out=w6)
        Logical Or(w6, $"STOPS MICROPHONE RECORDING") -> w8
        stop if w8
      }
    }
    frame 1 {
      while {
        call "GET_INFORTMATION_DIGIT.gvi"() -> (data=w9)
        call "niUSRP Write Tx Data (I16).gvi"(session handle=w3, data=w9, timeout=10, error in (no error)=w4, channel list="0,1") -> (session handle out=w5, Error Out=w6)
        Logical Or(w6, $"STOPS READING FROM AUDIO FILE") -> w10
        stop if w10
      }
    }
  }
  call "niUSRP Close Session.gvi"(Handle in=w5, error in (no error)=w6) -> (Error Out=w11)
  $"Error OUTPUT" <- w11
